# Grasshopper definition L2_custom_geometry.gh (Grasshopper 1.0.8)

number_slider = Slider(36, range=1..100)
# Plane 3
number_slider_2 = Slider(3, range=0..10)
xy_plane = XYPlane(Origin=Point(0, 0, 0))
unit_z = UnitZ(Factor=number_slider)
move = Move(Geometry=xy_plane, Motion=unit_z)  # -> Geometry, Transform
polygon = Polygon(Plane=move.Geometry, Radius=Slider(62, range=1..150), Segments=Slider(8, range=1..20), FilletRadius=number_slider_2)  # -> Polygon, Length

# ----
# Plane 2
number_slider_3 = Slider(2, range=0..10)
# Base Plate
xy_plane_2 = XYPlane(Origin=Point(0, 0, 0))
polygon_2 = Polygon(Plane=xy_plane_2, Radius=Slider(94, range=1..150), Segments=Slider(10, range=1..20), FilletRadius=number_slider_3)  # -> Polygon, Length

# ----
# Cutting shape
# Depth from base
number_slider_4 = Slider(-3, range=-100..0)
number = Number(-1)

xy_plane_3 = XYPlane(Origin=Point(0, 0, 0))

addition = Addition(A=number_slider, B=Slider(27, range=1..100))
addition_2 = Addition(A=addition, B=number_slider_4)

unit_z_2 = UnitZ(Factor=addition)
move_2 = Move(Geometry=xy_plane_3, Motion=unit_z_2)  # -> Geometry, Transform
polygon_3 = Polygon(
    Plane=move_2.Geometry,
    Radius=Slider(79, range=1..150),
    Segments=Slider(5, range=1..20),
    FilletRadius=Slider(7, range=0..10))  # -> Polygon, Length

unit_z_3 = UnitZ(Factor=addition_2)
polygon_4 = Polygon(
    Plane=move_2.Geometry,
    Radius=Slider(50, range=1..50),
    Segments=Slider(7, range=1..20),
    FilletRadius=Slider(0, range=0..10))  # -> Polygon, Length
multiplication = Multiplication(A=unit_z_3, B=number)
geometry = Geometry([polygon_2.Polygon, polygon.Polygon, polygon_3.Polygon])
extrude = Extrude(Base=polygon_4.Polygon, Direction=multiplication)
loft = Loft(Curves=geometry, Options={Adjust=False, Closed=False, LoftEnds=0, LoftSimp=0, LoftType=0, Rebuild=10, Refit=0.01})
cap_holes = CapHoles(Brep=extrude)
cap_holes_2 = CapHoles(Brep=loft)
solid_difference = SolidDifference(BrepsA=cap_holes_2, BrepsB=cap_holes)
