# Grasshopper definition L3-3DPSlicerGcodeGenerator1.gh (Grasshopper 1.0.8)
# plug-ins: Pancake

# ----
# Demo Cylinder
number_slider = Slider(0, range=0..105)
unit_z = UnitZ(Factor=1)
circ_radius = Slider(10, range=1..20)
circ_height = Slider(1.2, range=0.1..10)
construct_point = ConstructPoint(XCoordinate=number_slider, YCoordinate=number_slider, ZCoordinate=0)
circle_cnr = CircleCNR(Center=construct_point, Normal=unit_z, Radius=circ_radius)
unit_z_2 = UnitZ(Factor=circ_height)
extrude = Extrude(Base=circle_cnr, Direction=unit_z_2)
# [TODO]: Create Test Cylinder and Move to center of Bed
cap_holes = CapHoles(Brep=extrude)

nozzle_diameter = Slider(0.4, range=0.01..2)
filiment_diameter = Slider(1.75, range=0.01..2)
extrusion_width_mult = Slider(1.2, range=0.01..2)

layer_height = Slider(0.3, range=0.1..1)
# [TODO]: Create Infill Patterns
# [TODO]: Create Contours / Perimeters)
# Contour cutter
contour = Contour(Shape=cap_holes, Point=Point(0, 0, 0), Direction=Vector(0, 0, 1), Distance=layer_height)

multiplication = Multiplication(A=extrusion_width_mult, B=nozzle_diameter)

# ----
# remove plane directly on build plate
area = Area(Geometry=contour)  # -> Area, Centroid
deconstruct = Deconstruct(Point=area.Centroid)  # -> XComponent, YComponent, ZComponent
larger_than = LargerThan(FirstNumber=deconstruct.ZComponent, SecondNumber=layer_height)  # -> LargerThan, OrEqualTo
panel = Panel(deconstruct.ZComponent)
# areas for extruded filiment:
# A(rect)= LH * EW
# A(circ)= Pi* (Layer height)^2
# A(full)=A(r)+A(c)
# known:
# -layer height
# -nozzle diameter
# 
# need
# extrusion width
panel_2 = Panel(larger_than.OrEqualTo)
cull_pattern = CullPattern(List=contour, CullPattern=larger_than.OrEqualTo)
# [TODO]: Combine Perimeters and Infill
panel_3 = Panel(cull_pattern)

# ----
# full range
# Corrected step based on infil%
boundary_surfaces = BoundarySurfaces(Edges=cull_pattern)
# Make Infil lines
deconstruct_box = DeconstructBox(Box=boundary_surfaces)  # -> Plane, X, Y, Z
deconstruct_domain = DeconstructDomain(Domain=deconstruct_box.Z)  # -> Start, End
infil_density = Slider(1, range=0.001..1)
deconstruct_domain_2 = DeconstructDomain(Domain=deconstruct_box.Y)  # -> Start, End
deconstruct_domain_3 = DeconstructDomain(Domain=deconstruct_box.X)  # -> Start, End
extrusion_width = Number(multiplication)
exceed_the_radius = Number(1)
subtraction = Subtraction(A=deconstruct_domain_2.End, B=deconstruct_domain_2.Start)
division = Division(A=extrusion_width, B=infil_density)
addition = Addition(A=exceed_the_radius, B=deconstruct_domain_3.End)
# [TODO]: Create Line Segments from Perimeters and Infill
subtraction_2 = Subtraction(A=deconstruct_domain_3.Start, B=exceed_the_radius)
division_2 = Division(A=subtraction, B=division)
series = Series(Start=deconstruct_domain_2.Start, Step=division, Count=division_2)
# number of lines to make
panel_4 = Panel(division_2)
construct_point_2 = ConstructPoint(XCoordinate=subtraction_2, YCoordinate=series, ZCoordinate=deconstruct_domain.Start)
construct_point_3 = ConstructPoint(XCoordinate=addition, YCoordinate=series, ZCoordinate=deconstruct_domain.Start)
line = Line(StartPoint=construct_point_2, EndPoint=construct_point_3)

# ----
# Trimming infil lines
curve = Curve(boundary_surfaces)
brep_line = BrepLine(Brep=curve, Line=line, LimitToFirst=False)  # -> Curves, Points

# ----
# Trim Items here
number_slider_2 = Slider(2, range=0..4)
contour_outlines = Geometry(cull_pattern)
# merge data
panel_5 = Panel(contour_outlines)
panel_6 = Panel(brep_line.Curves)
trim_tree = TrimTree(Tree=brep_line.Curves, Depth=number_slider_2)
panel_7 = Panel(trim_tree)
merge = Merge(Data1=contour_outlines, Data2=trim_tree)
panel_8 = Panel(merge)
merged_geometry = Geometry(merge)

# ----
# Discretize the geometry
# Display Slices here
post_trimming_geometry = Geometry(merged_geometry)
discretize_length = Slider(0.1, range=0.1..1)
panel_9 = Panel(post_trimming_geometry)
divide_length = DivideLength(Curve=post_trimming_geometry, Length=discretize_length)  # -> Points, Tangents, Parameters
polyline = PolyLine(Vertices=divide_length.Points, Closed=False)
panel_10 = Panel(polyline)

explode = Explode(Curve=polyline, Recursive=True)  # -> Segments, Vertices

# ---- group: A second line for testing
construct_point_4 = ConstructPoint(XCoordinate=Slider(10, range=-10..30), YCoordinate=Slider(10, range=-10..30), ZCoordinate=Slider(1, range=-10..30))
construct_point_5 = ConstructPoint(XCoordinate=Slider(10, range=-10..30), YCoordinate=Slider(20, range=-10..30), ZCoordinate=Slider(1, range=-10..30))
line_2 = Line(StartPoint=construct_point_4, EndPoint=construct_point_5)

# ---- group: Example of a line for testing
# [TODO]: Use lines for testing gcode generation then replace with line segments from slicing
construct_point_6 = ConstructPoint(XCoordinate=Slider(5, range=-10..30), YCoordinate=Slider(1, range=-10..30), ZCoordinate=Slider(0, range=-10..30))
construct_point_7 = ConstructPoint(XCoordinate=Slider(30, range=-10..30), YCoordinate=Slider(1, range=-10..30), ZCoordinate=Slider(0, range=-10..30))
line_3 = Line(StartPoint=construct_point_6, EndPoint=construct_point_7)

# ----
line_4 = Line([line_3, line_2])
filiment_diameter_2 = Number(filiment_diameter)
extrusion_width_2 = Number(multiplication)
nozzle_diameter_2 = Number(nozzle_diameter)
layer_height_2 = Number(layer_height)
extrusion_feed_rate = Number(600)
layer_change_rate = Number(720)
# [TODO]: Implement the gcode generation algorithm in Python
# NOTE THAT THIS GCODE OUTPUT ASSUMES:
# - A PRUSA MK3S+ as the Printer
# - PLA Material
# - Extrusion Temperature: 215C
# - Heated Bed Temperature: 60C
travel_feed_rate = Panel("1200")
ghpython_script = GhPythonScript(
    lines=flatten(explode.Segments),
    nozzle_diameter=nozzle_diameter_2,
    filament_diameter=filiment_diameter_2,
    layer_height=layer_height_2,
    extrusion_width=extrusion_width_2,
    travel_feed_rate=travel_feed_rate,
    layer_change_feed_rate=layer_change_rate,
    extrusion_feed_rate=extrusion_feed_rate)  # -> out, gcode_output; inputs lines: list of Line
# ---------- ghpython_script: Python ----------
"""
    This file contains parameters, helpers, and setup to 
    create a basic gcode generation algorithm from line segments.
    
    The main 
    
    
    Inputs:
        lines: the line segments to be converted into gcode commands for extrusion 
        nozzle_diameter: the diameter of the 3D printer's nozzle
        filament_diameter: the diameter of the 3d printing filament
        layer_height: the height of each layer in the print
        extrusion_width: the width of the extruded line from the printer
        travel_feed_rate: the speed at which the extruder moves in X and Y
        layer_change_feed_rate: the speed at which teh extruder moves when 
            changing layers in the Z direction
        extrusion_feed_rate: the speed at which the extruder move when extruding

    Output:
        gcode_output: a string with gcode commands separate by new-lines"""

__author__ = "mrivera-cu"

import rhinoscriptsyntax as rs

import math


########## CONSTANTS BELOW ###############

# GCODE COMMANDS
COMMAND_MOVE = "G1"

# GCODE PARAM NAMES
PARAM_X = "X"
PARAM_Y = "Y"
PARAM_Z = "Z"
PARAM_E = "E"
PARAM_F = "F"

# Separates commands
COMMAND_DELIMITER = "\n"

# Precision for converting floats to strings
E_VALUE_PRECISION = 5
XYZ_VALUE_PRECISION = 3

# Float equality precision
FLOAT_EQUALITY_PRECISION = 5

#### WARNING: DO NOT EDIT THE START GCODE! #####
start_gcode_lines = [";START GCODE",
    "M201 X1000 Y1000 Z200 E5000 ; sets maximum accelerations, mm/sec^2",
    "M203 X200 Y200 Z12 E120 ; sets maximum feedrates, mm / sec",
    "M204 S1250 T1250 ; sets acceleration (S) and retract acceleration (R), mm/sec^2",
    "M205 X8.00 Y8.00 Z0.40 E4.50 ; sets the jerk limits, mm/sec",
    "M205 S0 T0 ; sets the minimum extruding and travel feed rate, mm/sec",
    ";TYPE:Custom",
    "M862.3 P \"MK3S\" ; printer model check",
    "M862.1 P0.4 ; nozzle diameter check",
    "M115 U3.13.3 ; tell printer latest fw version",
    "G90 ; use absolute coordinates",
    "M83 ; extruder relative mode",
    "M104 S215 ; set extruder temp",
    "M140 S60 ; set bed temp",
    "M190 S60 ; wait for bed temp",
    "M109 S215 ; wait for extruder temp",
    "G28 W ; home all without mesh bed level",
    "G80 X86.6877 Y64.7708 W85.2412 H59.1573 ; mesh bed levelling",
    "G1 Z0.2 F720",
    "G1 Y-3 F1000 ; go outside print area",
    "G92 E0",
    "G1 X60 E9 F1000 ; intro line",
    "G1 X100 E12.5 F1000 ; intro line",
    "G92 E0",
    "M221 S95",
    "; Don't change E values below. Excessive value can damage the printer.",
    "M907 E538 ; set extruder motor current",
    "G21 ; set units to millimeters",
    "G90 ; use absolute coordinates",
    "M83 ; use relative distances for extrusion",
    "M900 K0.05 ; Filament gcode LA 1.5",
    "M900 K30 ; Filament gcode LA 1.0",
    "M107"]
    
##### WARNING: DO NOT EDIT THE END GCODE! ######
end_gcode_lines = ["; END Gcode", 
    "M204 S1000", 
    "M107", 
    ";TYPE:Custom", 
    "; Filament-specific end gcode", 
    "G1 Z180 F720 ; Move print head further up", 
    "G1 X0 Y200 F3600 ; park", 
    "G4 ; wait",
    "M221 S100 ; reset flow",
    "M900 K0 ; reset LA",
    "M104 S0 ; turn off temperature",
    "M140 S0 ; turn off heatbed",
    "M107 ; turn off fan",
    "M84 ; disable motors",
    "M73 P100 R0 ; print progress done",
    "M73 Q100 S0 ; print progress done"]

#########################################################################

# Converts a float (f) to a string with some precision of decimal places
# For example: 
# Input: f=0.1234, precision=3 
# Output: "0.123"
def float_to_string(f, precision=XYZ_VALUE_PRECISION): 
    f = float(f)
    str_format = "{value:." + str(precision) +"f}"
    return str_format.format(value=f)
    
# Helper to convert the E value to the proper precision
def e_value_to_string(e):
    return float_to_string(e, E_VALUE_PRECISION)

# Helper to convert the XYZ value to the proper precision
def xyz_value_to_string(e):
    return float_to_string(e, XYZ_VALUE_PRECISION)

#########################################################################

# Helper function to compare floats in grasshopper/python due to float precision errors
def are_floats_equal(f1, f2, epsilon=10**(-FLOAT_EQUALITY_PRECISION)):
    f1 *= 10**FLOAT_EQUALITY_PRECISION
    f2 *= 10**FLOAT_EQUALITY_PRECISION
    return math.fabs(f2 - f1) <= epsilon
    
# Helper function to compare if two points are equal (have the same coordinates)
# by handling float precision comparisons
def is_same_pt(ptA, ptB):
    return are_floats_equal(ptA[0], ptB[0]) and are_floats_equal(ptA[1], ptB[1]) and are_floats_equal(ptA[2], ptB[2])
     
     
########################################################################
# creates a string consisting of a G1 move command and 
# any associated parameters
def gcode_move(current_pos, next_pos, feed_rate=None, should_extrude=False):
    # Start with "G1" as command
    move_command_str = COMMAND_MOVE
    
    # Compare X positions
    if (not are_floats_equal(current_pos[0],next_pos[0])):
        # we have a different x position so add it as a parameter to the command
        x_value = float_to_string(next_pos[0], precision=XYZ_VALUE_PRECISION)
        # Add X<x_value> to move string, e.g., X100.00
        move_command_str += " " + PARAM_X + x_value
    
    # Compare Y positions
    if (not are_floats_equal(current_pos[1], next_pos[1])):
        # we have a different y position so add the new position as a parameter
        y_value = float_to_string(next_pos[1], precision=XYZ_VALUE_PRECISION)
        # Add Y<y_value> to move string, e.g., Y100.00
        move_command_str += " " + PARAM_Y + y_value
    
    # Compare Z position
    if (not are_floats_equal(current_pos[2], next_pos[2])):
        # we have a different z position so add the new position as a parameter
        z_value = float_to_string(next_pos[2], precision=XYZ_VALUE_PRECISION)
        # Add Z<z_value> to move string, e.g., Z100.00
        move_command_str += " " + PARAM_Z + z_value
    
    # [TODO]: handle "should_extrude" == true by determining the proper amount to
    # extrude using the capsule model, then append the E parameter and value
    # to the move command.
    # NOTE: YOUR FLOAT PRECISION MUST MATCH E_VALUE_PRECISION
    
    if(should_extrude):#that it for the if statement?
        #does the carrot symbol work in python?
        move_dist = ((next_pos[0]-current_pos[0])**2+(next_pos[1]-current_pos[1])**2)**0.5
        e_value = (((extrusion_width-layer_height)*layer_height) + (3.141592*(layer_height/2)**2))/(3.141592*(filament_diameter/2)**2)
        e_value = e_value * move_dist

        #fix floating point precision here
        move_command_str += " " + PARAM_E + str(e_value)
    # See if we have a feedrate to use, and handle it differently than other 
    # parameters as it is an integer value
    if (feed_rate is not None):
        # feed rate is an int
        feed_rate_value = round(feed_rate)
        # Add F<feed_rate_value> to move string, e.g., F2000
        move_command_str += " " + PARAM_F + str(feed_rate_value)   
    
    # Remove excess whitespace on ends
    move_command_str = move_command_str.strip(" ")
    return move_command_str


############################################
############################################
############################################
    
''' Here's the main method of the script that uses the helper methods above '''

def generate_gcode():

    # [TODO]: Implement the algorithm to generate gcode for each layer by 
    # first to moveing to the layer height, then moving to each line segment.
    # Once at a line segment, you should move and extrude along it, 
    # then move (travel) to the next line until there are no lines left
    # For each of these movements, you should append the command to
    # the list: `all_move_commands`
    current_position = [0, 0, 0]        # start extruder at the origin
    all_move_commands = []              # list to hold for all the move commands

    for i in range(0, len(lines)):
        # Get pts of the line segment
        line = lines[i]
        line_start_position = line[0]
        line_end_position = line[1]
        #print("currently in loop part: ",i)
        #print("line disp: ",line_end_position)
        
        # X[TODO]: Handle moving to the next layer (Z Position)
        # NOTE- ALL Z MOVEMENTS SHOULD:
        # 1) BE INDEPENDENT MOVES(e.g., G1 Z# and not move with other positions like XYE) 
        # 2) USE THE `layer_change_feedrate`
        # 3) BE IN INCREASING ORDER
        if(not are_floats_equal(current_position[2], line_start_position[2])):
            a=[current_position[0],current_position[1],current_position[2]]
            b=[current_position[0],current_position[1],line_start_position[2]]
            move_z = gcode_move(a,b,feed_rate=layer_change_feed_rate)
            all_move_commands.append(move_z)
            current_position[2]=line_start_position[2]

        # Now if our current_position is not the start of our line segment
        # we need to move (travel) to the line segment's starting point
        if not is_same_pt(current_position, line_start_position):
            # [Move to the the line_start_position
            move_to_line_start_command = gcode_move(current_position, line_start_position, feed_rate=travel_feed_rate)
            # A ppend command
            all_move_commands.append(move_to_line_start_command)
        
        # [TODO]: Once our extruder is at the start of the line, create a 
        # command to move AND extrude along 
        # the line segment using `extrusion_feed_rate`
        ext_cmd = gcode_move(line_start_position, line_end_position, feed_rate=extrusion_feed_rate, should_extrude=True)
        all_move_commands.append(ext_cmd)

        # [TODO]: Append the move command across the line segment 

        
        # [TODO]: Update the current position of our extruder to be at the end of the line
        current_position = line_end_position
        
    # End of for-loop above -- now create the full set of commands


    # [TODO]: Once you have all of the move commands stored as a list in
    # `all_move_commands`, combine the `start_gcode`, `all_move_commands`, and `end_gcode`
    # into one list called `gcode_lines`   
    gcode_lines = [] 
    for item in start_gcode_lines:
        gcode_lines.append(item)
    for item in all_move_commands:
        gcode_lines.append(item)
    for item in end_gcode_lines:
        gcode_lines.append(item)

    #print("full array: ", gcode_lines)
    #print("item 0: ", gcode_lines[0])

    # --- DO NOT EDIT BELOW ----
    # The takes the combined gcode_lines list and creates a string containing each line
    # separated by a COMMAND_DELIMITER (the new-line character), and sets it 
    # to the `gcode_output`variable of this component
    output = COMMAND_DELIMITER.join(gcode_lines)
    
    return output
    
''' RUN THE MAIN FUNCITON ABOVE - DO NOT EDIT '''
# this sets the gcode commands to be the the `gcode_output` variable of this grasshopper component
gcode_output = generate_gcode()
# ---------- end ghpython_script ----------
# [TODO]: Initialize Input Parameters
debugging_panel = Panel(ghpython_script.out)
# [TODO]: Use Pancake Plug-in to Export Gcode Output File as .gcode
the_gcode_output = Panel(ghpython_script.gcode_output)
true_only_button = TrueOnlyButton(LastSaveLocalization="neutral,N")
export_txt = ExportTXT(
    Content=the_gcode_output,
    FileLocation="put file path here",
    Overwrite=Toggle(True),
    Encoding="utf-8",
    Export=true_only_button,
    LastSaveLocalization="neutral,N")
