# Grasshopper definition M3_generative_table_noise.gh (Grasshopper 1.0.8)
# plug-ins: RhinoCodePluginGH

radius_slider = Slider(14, range=1..30)
table_thickness = Slider(4, range=1..20)
# Front circle
construct_point = ConstructPoint(XCoordinate=radius_slider, YCoordinate=radius_slider, ZCoordinate=0)
subtraction = Subtraction(A=radius_slider, B=table_thickness)
circle_cnr = CircleCNR(Center=construct_point, Normal=Vector(0, 0, 1), Radius=radius_slider)
circle_cnr_2 = CircleCNR(Center=construct_point, Normal=Vector(0, 0, 1), Radius=subtraction)

subtraction_2 = Subtraction(A=Slider(80, range=20..80), B=radius_slider)
# Back circle
construct_point_2 = ConstructPoint(XCoordinate=subtraction_2, YCoordinate=radius_slider, ZCoordinate=0)
circle_cnr_3 = CircleCNR(Center=construct_point_2, Normal=Vector(0, 0, 1), Radius=radius_slider)
circle_cnr_4 = CircleCNR(Center=construct_point_2, Normal=Vector(0, 0, 1), Radius=subtraction)

# ----
# Add rectangle
# Remove rectangle
number = Number(2)
multiplication = Multiplication(A=radius_slider, B=number)
subtraction_3 = Subtraction(A=multiplication, B=table_thickness)
# Rectangles
construct_point_3 = ConstructPoint(XCoordinate=subtraction_2, YCoordinate=0, ZCoordinate=0)
construct_point_4 = ConstructPoint(XCoordinate=subtraction_2, YCoordinate=subtraction_3, ZCoordinate=0)
construct_point_5 = ConstructPoint(XCoordinate=radius_slider, YCoordinate=table_thickness, ZCoordinate=0)
rectangle_2pt = Rectangle2Pt(Plane=PlaneXY(0, 0, 0), PointA=construct_point_5, PointB=construct_point_4, Radius=0)  # -> Rectangle, Length
rectangle_2pt_2 = Rectangle2Pt(Plane=PlaneXY(0, 0, 0), PointA=construct_point_3, PointB=construct_point_5, Radius=0)  # -> Rectangle, Length

xy_plane = XYPlane(Origin=Point(0, 0, 0))
region_union = RegionUnion(Curves=[circle_cnr_2, circle_cnr_4, rectangle_2pt.Rectangle], Plane=xy_plane)
# Combine and Extrude shapes
region_union_2 = RegionUnion(Curves=[rectangle_2pt_2.Rectangle, circle_cnr_3, circle_cnr], Plane=xy_plane)
region_difference = RegionDifference(CurvesA=region_union_2, CurvesB=region_union, Plane=xy_plane)
unit_z = UnitZ(Factor=Slider(30, range=1..60))
surface = Surface(region_difference)
extrude = Extrude(Base=surface, Direction=unit_z)

# ----
# point array
# offset movement
number_slider = Slider(2, range=0..10)
# Indent pattern
number_slider_2 = Slider(6, range=1..20)
vector_xyz = VectorXYZ(XComponent=Slider(18, range=0..50), YComponent=Slider(0, range=0..10), ZComponent=Slider(2, range=0..10))  # -> Vector, Length
point_generator = Python3Script(length=number_slider_2, width=Slider(4, range=1..20), spacing=Slider(8, range=1..20))  # -> out, points
# ---------- point_generator: Python ----------
"""Grasshopper Script"""
import rhinoscriptsyntax as rs
import random as rng

_x=0
_y=0
_z=0
points = []

for i in range(0,int(length)):
    for j in range(0,int(width)):
        point = (i*spacing+_x, _y,j*spacing+_z)
        print(point)
        points.append(rs.AddPoint(point))
# ---------- end point_generator ----------
vector_xyz_2 = VectorXYZ(XComponent=number_slider, YComponent=0, ZComponent=0)  # -> Vector, Length
vector_xyz_3 = VectorXYZ(XComponent=0, YComponent=0, ZComponent=number_slider)  # -> Vector, Length
move = Move(Geometry=point_generator.points, Motion=vector_xyz.Vector)  # -> Geometry, Transform
move_2 = Move(Geometry=move.Geometry, Motion=vector_xyz_2.Vector)  # -> Geometry, Transform
move_3 = Move(Geometry=move.Geometry, Motion=vector_xyz_3.Vector)  # -> Geometry, Transform
python_3_script = Python3Script(point=move.Geometry, size=Slider(4, range=1..20), move1=move_2.Geometry, move2=move_3.Geometry)  # -> out, shape
# ---------- python_3_script: Python ----------
"""Grasshopper Script"""
import rhinoscriptsyntax as rs
import random as rng

_x = rs.AddPoint(10,0,0)
_z = rs.AddPoint(0,0,10)
print(_x)

#plane = rs.PlaneFitFromPoints(point_arr)
plane = rs.PlaneFromPoints(point,move1,move2)


shape = rs.AddRectangle(plane,size,size)
# ---------- end python_3_script ----------
panel = Panel(python_3_script.out)
surface_2 = Surface(python_3_script.shape)
unit_y = UnitY(Factor=Slider(1.2, range=0.5..10))
extrude_2 = Extrude(Base=surface_2, Direction=unit_y)

# ----
# Bake Me!
solid_difference = SolidDifference(BrepsA=extrude, BrepsB=extrude_2)
