# Grasshopper definition TriangleFabric1.gh (Grasshopper 1.0.8)
# plug-ins: RhinoCodePluginGH

# Making the Triangle
number_slider = Slider(5, range=0..10)
material_thickness = Slider(2.4, range=0.1..5)
side_length = Slider(24, range=1..35)
spacing = Slider(0.4, range=0.01..1)
construct_point = ConstructPoint(XCoordinate=number_slider, YCoordinate=Slider(4, range=0..10), ZCoordinate=Slider(2, range=0..10))
_3 = Number(3)
python_3_script = Python3Script(Start=construct_point, Length=side_length, Spacing=spacing, Height=material_thickness)  # -> out, Triangle, Points, Vectors
# ---------- python_3_script: Python ----------
"""Making the triangle"""
import rhinoscriptsyntax as rs
import math as m


angle = m.radians(60)
perp = m.radians(90)

Points =[]
Triangle = []
Vectors = []

Points.append(Start)
#print(Points[0])

temp = rs.AddPoint(Start[0]+Length,Start[1],Start[2])
temp2 = rs.VectorCreate(Start, temp)
Points.append(temp)
Vectors.append(temp2)
#print("1st new point", temp)
#print(Points[1])

#print("angle: ",m.cos(angle))
temp = rs.AddPoint(Start[0]+(Length*m.cos(angle)),Start[1]+(Length*m.sin(angle)),Start[2])
Points.append(temp)
temp2 = rs.VectorCreate(Points[1], temp)
Vectors.append(temp2)
temp2 = rs.VectorCreate(Points[2], Start)
Vectors.append(temp2)

#print("2nd new point", temp)

Points.append(Start)

#now i make a triangle as well
Triangle = rs.AddPolyline(Points)

Points.remove(Start)
# ---------- end python_3_script ----------

# ----
# normalized vector
division = Division(A=python_3_script.Vectors, B=side_length)

multiplication = Multiplication(A=division, B=spacing)

# ----
# inner hinge diameter
subtraction = Subtraction(A=material_thickness, B=spacing)
circle_cnr = CircleCNR(Center=python_3_script.Points, Normal=python_3_script.Vectors, Radius=subtraction)
multiplication_2 = Multiplication(A=spacing, B=division)
division_2 = Division(A=python_3_script.Vectors, B=Slider(3, range=0..10))
multiplication_3 = Multiplication(A=multiplication_2, B=Slider(2, range=0..10))
surface = Surface(circle_cnr)
subtraction_2 = Subtraction(A=division_2, B=multiplication_3)
extrude = Extrude(Base=surface, Direction=subtraction_2)
addition = Addition(A=division_2, B=multiplication_2)
move = Move(Geometry=extrude, Motion=addition)  # -> Geometry, Transform

printed_output = Panel(python_3_script.out)

# ----
# main shell
division_3 = Division(A=python_3_script.Vectors, B=_3)
circle_cnr_2 = CircleCNR(Center=python_3_script.Points, Normal=python_3_script.Vectors, Radius=material_thickness)
number = Number(-1)
surface_2 = Surface(circle_cnr_2)
multiplication_4 = Multiplication(A=division_3, B=number)
extrude_2 = Extrude(Base=surface_2, Direction=multiplication_4)
extrude_3 = Extrude(Base=surface_2, Direction=division_3)
move_2 = Move(Geometry=extrude_2, Motion=python_3_script.Vectors)  # -> Geometry, Transform
number_2 = Number(3)
division_4 = Division(A=python_3_script.Vectors, B=number_2)
external_hinge = Geometry([extrude_3, move_2.Geometry])
unit_z = UnitZ(Factor=material_thickness)
move_3 = Move(Geometry=extrude_3, Motion=division_4)  # -> Geometry, Transform
move_4 = Move(Geometry=move_3.Geometry, Motion=unit_z)  # -> Geometry, Transform

# ----
# Movement hinge cutter
division_5 = Division(A=material_thickness, B=_3)
addition_2 = Addition(A=material_thickness, B=spacing)
circle_cnr_3 = CircleCNR(Center=python_3_script.Points, Normal=python_3_script.Vectors, Radius=addition_2)
multiplication_5 = Multiplication(A=division, B=spacing)
surface_3 = Surface(circle_cnr_3)
addition_3 = Addition(A=division_3, B=multiplication_5)
number_3 = Number(-1)
multiplication_6 = Multiplication(A=addition_3, B=number_3)
extrude_4 = Extrude(Base=surface_3, Direction=multiplication_6)
extrude_5 = Extrude(Base=surface_3, Direction=addition_3)
move_5 = Move(Geometry=extrude_4, Motion=python_3_script.Vectors)  # -> Geometry, Transform
external_hinge_cutter = Geometry([extrude_5, move_5.Geometry])

unit_z_2 = UnitZ(Factor=material_thickness)
points = Panel(python_3_script.Points)
surface_4 = Surface(python_3_script.Triangle)
vectors = Panel(python_3_script.Vectors)
extrude_6 = Extrude(Base=surface_4, Direction=unit_z_2)
extrude_7 = Extrude(Base=surface_4, Direction=unit_z_2)

# ----
# corner cutter shapes
area = Area(Geometry=extrude_7)  # -> Area, Centroid
vector_2pt = Vector2Pt(PointA=area.Centroid, PointB=python_3_script.Points, Unitize=False)  # -> Vector, Length
move_6 = Move(Geometry=extrude_6, Motion=vector_2pt.Vector)  # -> Geometry, Transform
area_2 = Area(Geometry=move_6.Geometry)  # -> Area, Centroid
scale = Scale(Geometry=move_6.Geometry, Center=area_2.Centroid, Factor=Slider(0.5, range=0..1))  # -> Geometry, Transform
scale_nu = ScaleNU(Geometry=scale.Geometry, Plane=area_2.Centroid, ScaleX=1, ScaleY=1, ScaleZ=Slider(5, range=0..10))  # -> Geometry, Transform

move_7 = Move(Geometry=external_hinge_cutter, Motion=unit_z)  # -> Geometry, Transform
inner_hinge = Geometry(move.Geometry)
# Hinge Type 2
# room for type 1
solid_difference = SolidDifference(BrepsA=extrude_6, BrepsB=[external_hinge_cutter, move_7.Geometry])
number_slider_2 = Slider(2.9, range=0..5)
y_move_value = Number(0.29)
length = Number(side_length)
_2 = Number(2)
number_4 = Number(3.141592654)
multiplication_7 = Multiplication(A=length, B=y_move_value)
division_6 = Division(A=length, B=_2)
unit_y = UnitY(Factor=multiplication_7)
unit_x = UnitX(Factor=division_6)
# Input shape
geometry = Geometry()
boundary_surfaces = BoundarySurfaces(Edges=geometry)
deconstruct_box = DeconstructBox(Box=boundary_surfaces)  # -> Plane, X, Y, Z
deconstruct_domain = DeconstructDomain(Domain=deconstruct_box.X)  # -> Start, End
deconstruct_domain_2 = DeconstructDomain(Domain=deconstruct_box.Y)  # -> Start, End
subtraction_3 = Subtraction(A=deconstruct_domain_2.End, B=deconstruct_domain_2.Start)
subtraction_4 = Subtraction(A=deconstruct_domain.End, B=deconstruct_domain.Start)
lenght_ratio = Number(0.5)
height_ratio = Number(0.8675)
division_7 = Division(A=subtraction_4, B=lenght_ratio)
division_8 = Division(A=subtraction_3, B=height_ratio)
round = Round(Number=division_8)  # -> Nearest, Floor, Ceiling
round_2 = Round(Number=division_7)  # -> Nearest, Floor, Ceiling

# ----
# hole spacing
addition_4 = Addition(A=division_5, B=spacing)
circle_cnr_4 = CircleCNR(Center=python_3_script.Points, Normal=python_3_script.Vectors, Radius=addition_4)
number_5 = Number(-1)
surface_5 = Surface(circle_cnr_4)

# ----
# inner diameter
half_side_length = Number(5)
_2_2 = Number(2)
division_9 = Division(A=python_3_script.Vectors, B=half_side_length)
division_10 = Division(A=python_3_script.Vectors, B=_2_2)
circle_cnr_5 = CircleCNR(Center=python_3_script.Points, Normal=python_3_script.Vectors, Radius=division_5)
number_6 = Number(-1)
surface_6 = Surface(circle_cnr_5)

subtraction_5 = Subtraction(A=division_9, B=multiplication)

multiplication_8 = Multiplication(A=division_9, B=number_5)
extrude_8 = Extrude(Base=surface_5, Direction=division_9)
extrude_9 = Extrude(Base=surface_5, Direction=multiplication_8)
move_8 = Move(Geometry=extrude_8, Motion=division_10)  # -> Geometry, Transform
move_9 = Move(Geometry=extrude_9, Motion=division_10)  # -> Geometry, Transform
internal_spacing = Geometry([move_9.Geometry, move_8.Geometry])

multiplication_9 = Multiplication(A=subtraction_5, B=number_6)
extrude_10 = Extrude(Base=surface_6, Direction=subtraction_5)
extrude_11 = Extrude(Base=surface_6, Direction=multiplication_9)
move_10 = Move(Geometry=extrude_11, Motion=division_10)  # -> Geometry, Transform
move_11 = Move(Geometry=extrude_10, Motion=division_10)  # -> Geometry, Transform
inner_hinge_2 = Geometry([move_11.Geometry, move_10.Geometry])

# ----
# Edge Number display
number_slider_3 = Slider(0.6, range=0..10)
brep = Brep(internal_spacing)
deconstruct_brep = DeconstructBrep(Brep=brep)  # -> Faces, Edges, Vertices
point_on_curve = PointOnCurve(deconstruct_brep.Edges, parameter=0.5)
panel = Panel(deconstruct_brep.Edges)
fillet_edge = FilletEdge(Shape=brep, Blend=1, Metric=0, Edges=[0, 2], Radii=number_slider_3)
point_list = PointList(Points=point_on_curve, Size=Slider(0.95, range=0..10))

# ----
# Edge Number display
brep_2 = Brep(inner_hinge_2)
deconstruct_brep_2 = DeconstructBrep(Brep=brep_2)  # -> Faces, Edges, Vertices
point_on_curve_2 = PointOnCurve(deconstruct_brep_2.Edges, parameter=0.5)
subtraction_6 = Subtraction(A=number_slider_3, B=spacing)
panel_2 = Panel(deconstruct_brep_2.Edges)
fillet_edge_2 = FilletEdge(Shape=brep_2, Blend=1, Metric=0, Edges=[0, 2], Radii=subtraction_6)
point_list_2 = PointList(Points=point_on_curve_2, Size=Slider(0.95, range=0..10))

# ----
# type 1 hinge
# fitting the triangle
# beveled holes
solid_difference_2 = SolidDifference(BrepsA=extrude_6, BrepsB=[move_3.Geometry, move_4.Geometry])
solid_difference_3 = SolidDifference(BrepsA=[external_hinge, solid_difference_2], BrepsB=fillet_edge)
solid_union = SolidUnion(Breps=solid_difference_3)
solid_difference_4 = SolidDifference(BrepsA=solid_union, BrepsB=scale_nu.Geometry)

# ----
# inner hinge joining
solid_union_2 = SolidUnion(Breps=[solid_difference, fillet_edge_2, inner_hinge])
area_3 = Area(Geometry=solid_union_2)  # -> Area, Centroid
rotate = Rotate(Geometry=solid_union_2, Angle=number_4, Plane=area_3.Centroid)  # -> Geometry, Transform
move_12 = Move(Geometry=rotate.Geometry, Motion=unit_y)  # -> Geometry, Transform
move_13 = Move(Geometry=move_12.Geometry, Motion=unit_x)  # -> Geometry, Transform

# ----
# DEMO HINGE
demo_node = Geometry([move_13.Geometry, solid_difference_4])

# ----
# demo of basic array
number_slider_4 = Slider(10, range=1..30)
side_length_2 = Number(side_length)
construct_point_2 = ConstructPoint(XCoordinate=0, YCoordinate=0, ZCoordinate=0)
# Hinge Array
hinge_1 = Geometry(solid_difference_4)
hinge_2 = Geometry(move_12.Geometry)
python_3_script_2 = Python3Script(size=side_length_2, arr_x=number_slider_4, arr_y=Slider(6, range=1..30), start=construct_point_2)  # -> out, H1, H2
# ---------- python_3_script_2: Python ----------
"""Grasshopper Script"""
import rhinoscriptsyntax as rs
import math as m


H1=[]
H2=[]

x_scale = size * 0.5
y_scale = size * 0.8675

for i in range(int(arr_x)):
    for j in range(int(arr_y)):
        if((i+j) % 2 == 0):#type 1 hinge move
            temp = rs.CreatePoint(start[0]+(x_scale*i),start[1]+(y_scale*j),start[2])
            vec = rs.VectorCreate(start,temp)
            H1.append(vec)
        else:#type 2 hinge
            temp = rs.CreatePoint(start[0]+(x_scale*i),start[1]+(y_scale*j),start[2])
            vec = rs.VectorCreate(start,temp)
            H2.append(vec)
# ---------- end python_3_script_2 ----------
panel_3 = Panel(python_3_script_2.out)
move_14 = Move(Geometry=hinge_1, Motion=python_3_script_2.H1)  # -> Geometry, Transform
move_15 = Move(Geometry=hinge_2, Motion=python_3_script_2.H2)  # -> Geometry, Transform
geometry_2 = Geometry([move_14.Geometry, move_15.Geometry])
