# Grasshopper definition TriangleFabric2.gh (Grasshopper 1.0.8)
# plug-ins: RhinoCodePluginGH

# ----
# Making the Triangle
number_slider = Slider(4, range=0..10)
material_thickness = Slider(2.4, range=0.1..5)
side_length = Slider(24, range=1..35)
spacing = Slider(0.4, range=0.01..1)
construct_point = ConstructPoint(XCoordinate=Slider(5, range=0..10), YCoordinate=number_slider, ZCoordinate=Slider(2, range=0..10))
python_3_script = Python3Script(Start=construct_point, Length=side_length, Spacing=spacing, Height=material_thickness)  # -> out, Triangle, Points, Vectors
# ---------- python_3_script: Python ----------
"""Making the triangle"""
import rhinoscriptsyntax as rs
import math as m


angle = m.radians(60)
perp = m.radians(90)

Points =[]
Triangle = []
Vectors = []

Points.append(Start)
#print(Points[0])

temp = rs.AddPoint(Start[0]+Length,Start[1],Start[2])
temp2 = rs.VectorCreate(Start, temp)
Points.append(temp)
Vectors.append(temp2)
#print("1st new point", temp)
#print(Points[1])

#print("angle: ",m.cos(angle))
temp = rs.AddPoint(Start[0]+(Length*m.cos(angle)),Start[1]+(Length*m.sin(angle)),Start[2])
Points.append(temp)
temp2 = rs.VectorCreate(Points[1], temp)
Vectors.append(temp2)
temp2 = rs.VectorCreate(Points[2], Start)
Vectors.append(temp2)

#print("2nd new point", temp)

Points.append(Start)

#now i make a triangle as well
Triangle = rs.AddPolyline(Points)

Points.remove(Start)
# ---------- end python_3_script ----------
printed_output = Panel(python_3_script.out)
unit_z = UnitZ(Factor=material_thickness)
points = Panel(python_3_script.Points)
surface = Surface(python_3_script.Triangle)
vectors = Panel(python_3_script.Vectors)
extrude = Extrude(Base=surface, Direction=unit_z)
extrude_2 = Extrude(Base=surface, Direction=unit_z)

# ----
# normalized vector
division = Division(A=python_3_script.Vectors, B=side_length)

multiplication = Multiplication(A=division, B=spacing)

# ----
# inner hinge diameter
subtraction = Subtraction(A=material_thickness, B=spacing)
circle_cnr = CircleCNR(Center=python_3_script.Points, Normal=python_3_script.Vectors, Radius=subtraction)
multiplication_2 = Multiplication(A=spacing, B=division)
division_2 = Division(A=python_3_script.Vectors, B=Slider(3, range=0..10))
multiplication_3 = Multiplication(A=multiplication_2, B=Slider(2, range=0..10))
surface_2 = Surface(circle_cnr)
subtraction_2 = Subtraction(A=division_2, B=multiplication_3)
extrude_3 = Extrude(Base=surface_2, Direction=subtraction_2)
addition = Addition(A=division_2, B=multiplication_2)
move = Move(Geometry=extrude_3, Motion=addition)  # -> Geometry, Transform

_3 = Number(3)

# ----
# main shell
division_3 = Division(A=python_3_script.Vectors, B=_3)
circle_cnr_2 = CircleCNR(Center=python_3_script.Points, Normal=python_3_script.Vectors, Radius=material_thickness)
surface_3 = Surface(circle_cnr_2)
number = Number(-1)
multiplication_4 = Multiplication(A=division_3, B=number)
extrude_4 = Extrude(Base=surface_3, Direction=multiplication_4)
extrude_5 = Extrude(Base=surface_3, Direction=division_3)
move_2 = Move(Geometry=extrude_4, Motion=python_3_script.Vectors)  # -> Geometry, Transform
number_2 = Number(3)
division_4 = Division(A=python_3_script.Vectors, B=number_2)
external_hinge = Geometry([extrude_5, move_2.Geometry])
unit_z_2 = UnitZ(Factor=material_thickness)
move_3 = Move(Geometry=extrude_5, Motion=division_4)  # -> Geometry, Transform
move_4 = Move(Geometry=move_3.Geometry, Motion=unit_z_2)  # -> Geometry, Transform

# ----
# Movement hinge cutter
division_5 = Division(A=material_thickness, B=_3)
addition_2 = Addition(A=material_thickness, B=spacing)
circle_cnr_3 = CircleCNR(Center=python_3_script.Points, Normal=python_3_script.Vectors, Radius=addition_2)
multiplication_5 = Multiplication(A=division, B=spacing)
surface_4 = Surface(circle_cnr_3)
addition_3 = Addition(A=division_3, B=multiplication_5)
number_3 = Number(-1)
multiplication_6 = Multiplication(A=addition_3, B=number_3)
extrude_6 = Extrude(Base=surface_4, Direction=multiplication_6)
extrude_7 = Extrude(Base=surface_4, Direction=addition_3)
move_5 = Move(Geometry=extrude_6, Motion=python_3_script.Vectors)  # -> Geometry, Transform
external_hinge_cutter = Geometry([extrude_7, move_5.Geometry])

# ----
# corner cutter shapes
area = Area(Geometry=extrude_2)  # -> Area, Centroid
vector_2pt = Vector2Pt(PointA=area.Centroid, PointB=python_3_script.Points, Unitize=False)  # -> Vector, Length
move_6 = Move(Geometry=extrude, Motion=vector_2pt.Vector)  # -> Geometry, Transform
area_2 = Area(Geometry=move_6.Geometry)  # -> Area, Centroid
scale = Scale(Geometry=move_6.Geometry, Center=area_2.Centroid, Factor=Slider(0.5, range=0..1))  # -> Geometry, Transform
scale_nu = ScaleNU(Geometry=scale.Geometry, Plane=area_2.Centroid, ScaleX=1, ScaleY=1, ScaleZ=Slider(5, range=0..10))  # -> Geometry, Transform

# ----
# Input shape
geometry = Geometry(<curve referenced from the Rhino model>)
boundary_surfaces = BoundarySurfaces(Edges=geometry)

# ----
# Defining size
deconstruct_box = DeconstructBox(Box=boundary_surfaces)  # -> Plane, X, Y, Z
deconstruct_domain = DeconstructDomain(Domain=deconstruct_box.X)  # -> Start, End
deconstruct_domain_2 = DeconstructDomain(Domain=deconstruct_box.Y)  # -> Start, End
subtraction_3 = Subtraction(A=deconstruct_domain_2.End, B=deconstruct_domain_2.Start)
subtraction_4 = Subtraction(A=deconstruct_domain.End, B=deconstruct_domain.Start)
lenght_ratio = Number(0.5)
height_ratio = Number(0.8675)
multiplication_7 = Multiplication(A=side_length, B=lenght_ratio)
multiplication_8 = Multiplication(A=side_length, B=height_ratio)
division_6 = Division(A=subtraction_4, B=multiplication_7)
division_7 = Division(A=subtraction_3, B=multiplication_8)
round = Round(Number=division_7)  # -> Nearest, Floor, Ceiling
round_2 = Round(Number=division_6)  # -> Nearest, Floor, Ceiling

# ----
# Input Rectange
addition_4 = Addition(A=deconstruct_domain_2.End, B=side_length)
addition_5 = Addition(A=deconstruct_domain.End, B=side_length)
subtraction_5 = Subtraction(A=deconstruct_domain.Start, B=side_length)
subtraction_6 = Subtraction(A=deconstruct_domain_2.Start, B=side_length)
construct_point_2 = ConstructPoint(XCoordinate=subtraction_5, YCoordinate=subtraction_6, ZCoordinate=0)
construct_point_3 = ConstructPoint(XCoordinate=addition_5, YCoordinate=addition_4, ZCoordinate=0)
rectangle_2pt = Rectangle2Pt(Plane=PlaneXY(0, 0, 0), PointA=construct_point_2, PointB=construct_point_3, Radius=0)  # -> Rectangle, Length

vector_xyz = VectorXYZ(XComponent=deconstruct_domain.End, YComponent=deconstruct_domain_2.End, ZComponent=0)  # -> Vector, Length
vector_xyz_2 = VectorXYZ(XComponent=side_length, YComponent=side_length, ZComponent=0)  # -> Vector, Length
# Cutting shape
subtraction_7 = Subtraction(A=vector_xyz.Vector, B=vector_xyz_2.Vector)

unit_z_3 = UnitZ(Factor=Slider(11, range=1..40))
surface_5 = Surface(rectangle_2pt.Rectangle)
surface_6 = Surface(geometry)
extrude_8 = Extrude(Base=surface_6, Direction=unit_z_3)
extrude_9 = Extrude(Base=surface_5, Direction=unit_z_3)
solid_difference = SolidDifference(BrepsA=extrude_9, BrepsB=extrude_8)
unit_z_4 = UnitZ(Factor=Slider(-2, range=-5..10))
move_7 = Move(Geometry=solid_difference, Motion=unit_z_4)  # -> Geometry, Transform

width = Number(round.Ceiling)
panel = Panel(width)
heigh = Number(round_2.Ceiling)
panel_2 = Panel(heigh)

# ----
# hole spacing
addition_6 = Addition(A=division_5, B=spacing)
circle_cnr_4 = CircleCNR(Center=python_3_script.Points, Normal=python_3_script.Vectors, Radius=addition_6)
number_4 = Number(-1)
surface_7 = Surface(circle_cnr_4)

# ----
# inner diameter
half_side_length = Number(5)
_2 = Number(2)
division_8 = Division(A=python_3_script.Vectors, B=half_side_length)
division_9 = Division(A=python_3_script.Vectors, B=_2)
circle_cnr_5 = CircleCNR(Center=python_3_script.Points, Normal=python_3_script.Vectors, Radius=division_5)
number_5 = Number(-1)
surface_8 = Surface(circle_cnr_5)

subtraction_8 = Subtraction(A=division_8, B=multiplication)

multiplication_9 = Multiplication(A=division_8, B=number_4)
extrude_10 = Extrude(Base=surface_7, Direction=division_8)
extrude_11 = Extrude(Base=surface_7, Direction=multiplication_9)
move_8 = Move(Geometry=extrude_10, Motion=division_9)  # -> Geometry, Transform
move_9 = Move(Geometry=extrude_11, Motion=division_9)  # -> Geometry, Transform
internal_spacing = Geometry([move_9.Geometry, move_8.Geometry])

multiplication_10 = Multiplication(A=subtraction_8, B=number_5)
extrude_12 = Extrude(Base=surface_8, Direction=subtraction_8)
extrude_13 = Extrude(Base=surface_8, Direction=multiplication_10)
move_10 = Move(Geometry=extrude_13, Motion=division_9)  # -> Geometry, Transform
move_11 = Move(Geometry=extrude_12, Motion=division_9)  # -> Geometry, Transform
inner_hinge = Geometry([move_11.Geometry, move_10.Geometry])

# ----
# Edge Number display
number_slider_2 = Slider(0.6, range=0..10)
# cutting chamfer
brep = Brep(internal_spacing)
deconstruct_brep = DeconstructBrep(Brep=brep)  # -> Faces, Edges, Vertices
point_on_curve = PointOnCurve(deconstruct_brep.Edges, parameter=0.5)
panel_3 = Panel(deconstruct_brep.Edges)
fillet_edge = FilletEdge(Shape=brep, Blend=1, Metric=0, Edges=[0, 2], Radii=number_slider_2)
point_list = PointList(Points=point_on_curve, Size=Slider(0.95, range=0..10))

# ----
# Hinge rod chamfer
# Edge Number display
brep_2 = Brep(inner_hinge)
deconstruct_brep_2 = DeconstructBrep(Brep=brep_2)  # -> Faces, Edges, Vertices
point_on_curve_2 = PointOnCurve(deconstruct_brep_2.Edges, parameter=0.5)
subtraction_9 = Subtraction(A=number_slider_2, B=spacing)
panel_4 = Panel(deconstruct_brep_2.Edges)
fillet_edge_2 = FilletEdge(Shape=brep_2, Blend=1, Metric=0, Edges=[0, 2], Radii=subtraction_9)
point_list_2 = PointList(Points=point_on_curve_2, Size=Slider(0.95, range=0..10))

# ----
# type 1 hinge
# fitting the triangle
# beveled holes
solid_difference_2 = SolidDifference(BrepsA=extrude, BrepsB=[move_3.Geometry, move_4.Geometry])
solid_difference_3 = SolidDifference(BrepsA=[external_hinge, solid_difference_2], BrepsB=fillet_edge)
solid_union = SolidUnion(Breps=solid_difference_3)
solid_difference_4 = SolidDifference(BrepsA=solid_union, BrepsB=scale_nu.Geometry)

# ----
# Hinge Type 2
# room for type 1
# inner hinge joining
move_12 = Move(Geometry=external_hinge_cutter, Motion=unit_z_2)  # -> Geometry, Transform
inner_hinge_2 = Geometry(move.Geometry)
solid_difference_5 = SolidDifference(BrepsA=extrude, BrepsB=[external_hinge_cutter, move_12.Geometry])
solid_union_2 = SolidUnion(Breps=[solid_difference_5, fillet_edge_2, inner_hinge_2])

y_move_value = Number(0.29)
length = Number(side_length)
_2_2 = Number(2)
area_3 = Area(Geometry=solid_union_2)  # -> Area, Centroid
# Move Hinge 2
number_6 = Number(3.141592654)
multiplication_11 = Multiplication(A=length, B=y_move_value)
rotate = Rotate(Geometry=solid_union_2, Angle=number_6, Plane=area_3.Centroid)  # -> Geometry, Transform
division_10 = Division(A=length, B=_2_2)
unit_y = UnitY(Factor=multiplication_11)
move_13 = Move(Geometry=rotate.Geometry, Motion=unit_y)  # -> Geometry, Transform
unit_x = UnitX(Factor=division_10)
move_14 = Move(Geometry=move_13.Geometry, Motion=unit_x)  # -> Geometry, Transform

demo_node = Geometry([move_14.Geometry, solid_difference_4])

# ----
# Hinge Array
# demo of basic array
side_length_2 = Number(side_length)
construct_point_4 = ConstructPoint(XCoordinate=0, YCoordinate=0, ZCoordinate=0)
hinge_1 = Geometry(solid_difference_4)
hinge_2 = Geometry(move_13.Geometry)
python_3_script_2 = Python3Script(size=side_length_2, arr_x=panel_2, arr_y=width, start=construct_point_4)  # -> out, H1, H2
# ---------- python_3_script_2: Python ----------
"""Grasshopper Script"""
import rhinoscriptsyntax as rs
import math as m


H1=[]
H2=[]

x_scale = size * 0.5
y_scale = size * 0.8675

for i in range(int(arr_x)):
    for j in range(int(arr_y)):
        if((i+j) % 2 == 0):#type 1 hinge move
            temp = rs.CreatePoint(start[0]+(x_scale*i),start[1]+(y_scale*j),start[2])
            vec = rs.VectorCreate(start,temp)
            H1.append(vec)
        else:#type 2 hinge
            temp = rs.CreatePoint(start[0]+(x_scale*i),start[1]+(y_scale*j),start[2])
            vec = rs.VectorCreate(start,temp)
            H2.append(vec)
# ---------- end python_3_script_2 ----------
panel_5 = Panel(python_3_script_2.out)
move_15 = Move(Geometry=hinge_1, Motion=python_3_script_2.H1)  # -> Geometry, Transform
move_16 = Move(Geometry=hinge_2, Motion=python_3_script_2.H2)  # -> Geometry, Transform
geometry_2 = Geometry([move_15.Geometry, move_16.Geometry])

# ----
# removing the excess from the input shape
# Normal cut ending
move_17 = Move(Geometry=geometry_2, Motion=subtraction_7)  # -> Geometry, Transform
flatten_tree = FlattenTree(Tree=move_17.Geometry, Path="{0}")
side_length_3 = Number(side_length)
height = Number(material_thickness)
mesh_difference = MeshDifference(MeshesA=flatten_tree, MeshesB=move_7.Geometry)
multiplication_12 = Multiplication(A=height, B=side_length_3)
multiplication_13 = Multiplication(A=multiplication_12, B=side_length_3)
volume = Volume(Geometry=mesh_difference)  # -> Volume, Centroid
division_11 = Division(A=multiplication_13, B=Slider(4, range=1..10))
larger_than = LargerThan(FirstNumber=volume.Volume, SecondNumber=division_11)  # -> LargerThan, OrEqualTo
cull_pattern = CullPattern(List=mesh_difference, CullPattern=larger_than.LargerThan)
panel_6 = Panel(larger_than.OrEqualTo)

area_4 = Area(Geometry=cull_pattern)  # -> Area, Centroid
panel_7 = Panel(area_4.Centroid)
area_5 = Area(Geometry=move_17.Geometry)  # -> Area, Centroid
panel_8 = Panel(area_5.Centroid)
flatten_tree_2 = FlattenTree(Tree=area_4.Centroid, Path="{0}")
flatten_tree_3 = FlattenTree(Tree=area_5.Centroid, Path="{0}")
# Non-cut piece outline
cross_reference = CrossReference(ListListA=flatten_tree_3, ListListB=flatten_tree_2, CrossMode=1)  # -> ListListA, ListListB
python_3_script_3 = Python3Script(All_hinges=cross_reference.ListListA, inside=cross_reference.ListListB, length=Slider(22, range=1..40))  # -> out, bools
# ---------- python_3_script_3: Python ----------
"""Grasshopper Script"""
import rhinoscriptsyntax as rs
import math as m


bools=[]


x1=All_hinges[0]
y1=All_hinges[1]
print("all: ",x1," ",y1)

x2=inside[0]
y2=inside[1]
print("inside: ",x2," ",y2)

dist=((x1-x2)**2+(y1-y2)**2)**0.5
if(dist <= length):
    bools.append(True)
else:
    bools.append(False)
# ---------- end python_3_script_3 ----------
panel_9 = Panel(python_3_script_3.bools)
cull_pattern_2 = CullPattern(List=move_17.Geometry, CullPattern=[False, False, True, True])
panel_10 = Panel(python_3_script_3.out)
