# Grasshopper definition laser_slicer2.gh (Grasshopper 1.0.8)

mesh = Mesh([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])

# ----
# Object
# Starting point
# Vector Cutting
# Material thickness (mm)
number_slider = Slider(0, range=0..10)
mesh_2 = Mesh(mesh)
mesh_union = MeshUnion(Meshes=mesh_2)
construct_point = ConstructPoint(XCoordinate=number_slider, YCoordinate=Slider(0, range=0..10), ZCoordinate=Slider(0, range=0..10))
construct_point_2 = ConstructPoint(XCoordinate=Slider(0, range=-10..10), YCoordinate=Slider(0, range=-10..10), ZCoordinate=Slider(1, range=-10..10))
contour = Contour(Shape=mesh_union, Point=construct_point, Direction=construct_point_2, Distance=Slider(2.25, range=0.125..10))

# ----
# Cutting the Model
geometry = Geometry(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)
geometry_2 = Geometry(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)
# vector direction of cutting plane
vector_2pt = Vector2Pt(PointA=construct_point, PointB=construct_point_2, Unitize=False)  # -> Vector, Length
number = Number(-1)
panel = Panel(mesh_union)
curve = Curve(contour)
end_points = EndPoints(Curve=curve)  # -> Start, End
# Moving down vector
multiplication = Multiplication(A=vector_2pt.Vector, B=number)
panel_2 = Panel(contour)
line = Line(StartPoint=end_points.Start, EndPoint=end_points.End)
join_curves = JoinCurves(Curves=[curve, line], Preserve=False)

# ----
# Filters
# area greater than 4mm^2
# Is closed loop?
closed = Closed(Curve=join_curves)  # -> Closed, Periodic
panel_3 = Panel(closed.Closed)
cull_pattern = CullPattern(List=join_curves, CullPattern=closed.Closed)
area = Area(Geometry=cull_pattern)  # -> Area, Centroid
number_2 = Number(4)
larger_than = LargerThan(FirstNumber=area.Area, SecondNumber=Slider(4, range=4..80))  # -> LargerThan, OrEqualTo
panel_4 = Panel(larger_than.OrEqualTo)
cull_pattern_2 = CullPattern(List=cull_pattern, CullPattern=larger_than.OrEqualTo)

# ----
# Moving slices
geometry_3 = Geometry(cull_pattern_2)
area_2 = Area(Geometry=geometry_3)  # -> Area, Centroid
# spacing of cutouts
number_slider_2 = Slider(19, range=1..100)
# get center
deconstruct = Deconstruct(Point=area_2.Centroid)  # -> XComponent, YComponent, ZComponent
multiplication_2 = Multiplication(A=deconstruct.ZComponent, B=number_slider_2)
addition = Addition(A=deconstruct.XComponent, B=multiplication_2)
construct_point_3 = ConstructPoint(XCoordinate=addition, YCoordinate=deconstruct.YComponent, ZCoordinate=0)
vector_2pt_2 = Vector2Pt(PointA=area_2.Centroid, PointB=construct_point_3, Unitize=False)  # -> Vector, Length
move = Move(Geometry=geometry_3, Motion=vector_2pt_2.Vector)  # -> Geometry, Transform

# ----
# Make uniform
# Making text
# correct any offset
# make a whole number
# make it a surface so it is paralel to the plane
# move if center is a hole
geometry_4 = Geometry(move.Geometry)
# text on surface
area_3 = Area(Geometry=geometry_4)  # -> Area, Centroid
# shape outlines
number_slider_3 = Slider(0, range=0..10)
deconstruct_2 = Deconstruct(Point=area_3.Centroid)  # -> XComponent, YComponent, ZComponent
multiplication_3 = Multiplication(A=deconstruct_2.XComponent, B=Slider(2, range=1..20))
# position correcting
number_slider_4 = Slider(0, range=0..10)
construct_point_4 = ConstructPoint(XCoordinate=multiplication_3, YCoordinate=Slider(0, range=0..10), ZCoordinate=number_slider_3)
surface = Surface(geometry_4)
# origin
construct_point_5 = ConstructPoint(XCoordinate=Slider(0, range=0..10), YCoordinate=Slider(0, range=0..10), ZCoordinate=number_slider_4)
addition_2 = Addition(A=deconstruct_2.XComponent, B=Slider(-6.81, range=-200..300))
line_2 = Line(StartPoint=construct_point_5, EndPoint=construct_point_4)
division = Division(A=addition_2, B=Slider(42, range=1..400))
integer = Integer(division)
text = Text(integer)
text_on_surface = TextOnSurface(
    Text=text,
    Font="Sans Bold:no Italic:no",
    Height=Slider(5, range=1..40),
    Depth=Slider(0, range=0..2),
    BaseLine=line_2,
    BaseSurface=surface)
vector_xyz = VectorXYZ(XComponent=Slider(2, range=0..100), YComponent=Slider(2, range=0..100), ZComponent=Slider(0, range=0..100))  # -> Vector, Length
move_2 = Move(Geometry=text_on_surface, Motion=vector_xyz.Vector)  # -> Geometry, Transform

panel_5 = Panel(division)
panel_6 = Panel(text)
# placing text
# shape outlines
geometry_5 = Geometry(move_2.Geometry)
# Click Here
# 
# And Export Selected
geometry_6 = Geometry([geometry_4, geometry_5])
